# Grasshopper definition PathCreation.gh (Grasshopper 1.0.7)
# plug-ins: Human, PathCreation

组团1 = Curve([<curve referenced from the Rhino model> x2])
组团2 = Curve([<curve referenced from the Rhino model> x2])
组团3 = Curve(<curve referenced from the Rhino model>)
组团4 = Curve(<curve referenced from the Rhino model>)
bbox = BoundingBox(Content=组团1, Plane=PlaneXY(0, 0, 0), UnionBox=True)  # -> Box, Box_2
bbox_2 = BoundingBox(Content=组团2, Plane=PlaneXY(0, 0, 0), UnionBox=True)  # -> Box, Box_2
bbox_3 = BoundingBox(Content=组团3, Plane=PlaneXY(0, 0, 0), UnionBox=True)  # -> Box, Box_2
bbox_4 = BoundingBox(Content=组团4, Plane=PlaneXY(0, 0, 0), UnionBox=True)  # -> Box, Box_2
场地外围线 = Curve(<curve referenced from the Rhino model>)
crv = Curve(reparameterize(<curve referenced from the Rhino model>))
crv_2 = Curve(reparameterize(<curve referenced from the Rhino model>))
entwine = Entwine(Branch00=bbox.Box, Branch01=bbox_2.Box, Branch02=bbox_3.Box, Branch03=bbox_4.Box, FlattenInputs=True)
crv_3 = Curve(reparameterize(crv))
crv_4 = Curve(场地外围线)
rec = Rectangle(entwine)
场地外围线_2 = Curve(crv_4)
scalebox = ScaleBox(num=Slider(3, range=0..100), R=crv_3)
eval = EvaluateCurve(Curve=crv_3, Parameter=Slider(0.7, range=0..1))  # -> Point, Tangent, Angle
number_slider = Slider(3.3, range=0..10)
crv_5 = Curve(reparameterize(crv_2))
num = Number(number_slider)
crv_6 = Curve(reparameterize(<curve referenced from the Rhino model>))
disc = Discontinuity(Curve=rec, Level=1)  # -> Points, Parameters
subtraction = Subtraction(A=num, B=Slider(0, range=0..10))
addition = Addition(A=num, B=Slider(5, range=0..10))
scalebox_2 = ScaleBox(num=Slider(5, range=0..100), R=crv_5)
eval_2 = EvaluateCurve(Curve=crv_5, Parameter=Slider(0.1, range=0..1))  # -> Point, Tangent, Angle
crv_7 = Curve(<curve referenced from the Rhino model>)
neg = Negative(Value=Slider(0.8, range=0..1))
crv_8 = Curve(scalebox_2)
offset = OffsetCurve(Curve=crv_6, Distance=expr("-x", addition), Corners=1)
eval_3 = EvaluateCurve(Curve=crv_6, Parameter=Slider(0.58, range=0..1))  # -> Point, Tangent, Angle
offset_2 = OffsetCurve(Curve=crv_6, Distance=addition, Corners=1)
scalebox_3 = ScaleBox(num=Slider(2, range=0..100), R=crv_7)
scalebox_4 = ScaleBox(num=neg, R=crv_8)
entwine_2 = Entwine(Branch00=offset_2, Branch01=offset, FlattenInputs=True)  # -> flatten(Result)
crv_9 = Curve([scalebox_4, scalebox_3])
crvprox = CurveProximity(CurveA=crv_5, CurveB=entwine_2)  # -> PointA, PointB, Distance
crv_cp = CurveClosestPoint(Point=eval_2.Point, Curve=scalebox_2)  # -> Point, Parameter, Distance
sort = SortList(Keys=crvprox.Distance, ValuesA=entwine_2)  # -> Keys, ValuesA

# ---- group: 端点显示
cir = Circle(Plane=[eval_3.Point, eval_2.Point], Radius=Slider(5, range=0..10))
dash = DashPattern(Curve=cir, Pattern="1")  # -> Dashes, Gaps
previewlw = CustomPreviewLineweights(Geometry=dash.Dashes, Shader=ColourSwatch(SwatchColor=RGB(255, 55, 0)), Thickness=Slider(2, range=0..10), Absolute=False)

# ----
item = ListItem(List=sort.ValuesA, Index=0, Wrap=True)
crv_cp_2 = CurveClosestPoint(Point=eval_3.Point, Curve=item)  # -> Point, Parameter, Distance
pc = PathCreation(
    StartPoint=crv_cp.Point,
    EndPoint=crv_cp_2.Point,
    Obstacle=crv_9,
    Resolution=Slider(13, range=0..100),
    Orthogonal=Toggle(True))  # -> OutputPath, PathGrid
explode = Explode(Curve=pc.OutputPath, Recursive=True)  # -> Segments, Vertices
join = JoinCurves(Curves=explode.Segments, Preserve=False)
disc_2 = Discontinuity(Curve=join, Level=1)  # -> Points, Parameters
rev = ReverseList(List=disc_2.Points)
道路宽度 = Slider(6, range=0..10)
ins = InsertItems(List=rev, Item=eval_2.Point, Indices=Slider(0, range=0..100), Wrap=True)
ins_2 = InsertItems(List=ins, Item=eval_3.Point, Indices="-1", Wrap=True)
number_slider_2 = Slider(7, range=0..10)
number_slider_3 = Slider(5, range=0..10)
addition_2 = Addition(A=number_slider_3, B=number_slider_2)
offset_3 = OffsetCurve(Curve=场地外围线_2, Distance=expr("-x", addition_2), Corners=1)
offset_4 = OffsetCurve(Curve=场地外围线_2, Distance=expr("-x", number_slider_3), Corners=1)

# ---- group: 组团分割路
宽度 = Slider(5, range=0..10)  # disabled
padding = Slider(5, range=0..10)  # disabled
division = Division(A=宽度, B=2)  # disabled
addition_3 = Addition(A=padding, B=division)  # disabled
number_slider_4 = Slider(4, range=0..10)  # disabled
offset_5 = OffsetCurve(Curve=rec, Distance=addition_3, Corners=1)  # disabled
division_2 = Division(A=padding, B=2)  # disabled
number_slider_5 = Slider(100, range=0..100)  # disabled
fillet = Fillet(Curve=offset_5, Radius=number_slider_4)  # disabled
offset_6 = OffsetCurve(Curve=fillet, Distance=expr("-x", division_2), Corners=1)  # disabled
offset_7 = OffsetCurve(Curve=fillet, Distance=division_2, Corners=1)  # disabled
crv_10 = Curve(offset_4)  # disabled
offset_8 = OffsetCurve(Curve=crv_10, Distance=number_slider_5, Corners=1)  # disabled
merge = Merge(Data1=offset_7, Data2=offset_6)  # disabled
Z = UnitZ(Factor=1)  # disabled
boundary = BoundarySurfaces(Edges=flatten([crv_10, offset_8]))  # disabled
loft = Loft(Curves=merge, Options={Adjust=False, Closed=False, LoftEnds=0, LoftSimp=0, LoftType=0, Rebuild=10, Refit=0.01})  # disabled
move = Move(Geometry=boundary, Motion=Z)  # -> Geometry, Transform; disabled
multiplication = Multiplication(A=Z, B=-2)  # disabled
boundary_2 = BoundarySurfaces(Edges=flatten([offset_3, offset_4]))  # disabled
extr = Extrude(Base=move.Geometry, Direction=multiplication)  # disabled
trim = TrimSolid(Shape=loft, Cutters=extr)  # disabled
sunion = SolidUnion(Breps=flatten([trim, boundary_2]))  # disabled
edges = BrepEdges(Brep=sunion)  # -> Naked, Interior, NonManifold; disabled
number_slider_6 = Slider(2, range=0..10)  # disabled
area = Area(Geometry=rec)  # -> Area, Centroid; disabled
crv_11 = Curve(edges.Naked)  # disabled
sort_2 = SortList(Keys=flatten(area.Area))  # -> Keys, ValuesA; disabled
join_2 = JoinCurves(Curves=crv_11, Preserve=False)  # disabled
fillet_2 = Fillet(Curve=join_2, Radius=number_slider_6)  # disabled
item_2 = ListItem(List=sort_2.Keys, Index=0, Wrap=True)  # disabled
area_2 = Area(Geometry=fillet_2)  # -> Area, Centroid; disabled
smaller = SmallerThan(FirstNumber=area_2.Area, SecondNumber=item_2)  # -> SmallerThan, OrEqualTo; disabled
dispatch = Dispatch(List=fillet_2, DispatchPattern=smaller.OrEqualTo)  # -> ListA, ListB; disabled
crv_12 = Curve(dispatch.ListB)  # disabled
boundary_3 = BoundarySurfaces(Edges=flatten(crv_12))  # disabled

# ----
bbox_5 = BoundingBox(Content=offset_4, Plane=PlaneXY(0, 0, 0), UnionBox=True)  # -> Box, Box_2
c_script = CSharpScript(Box=bbox_5.Box)  # -> A; inputs Box: Box
# ---------- c_script: C# ----------
    A = Box.Center;
# ---------- end c_script ----------
dist = Distance(PointA=c_script, PointB=disc.Points)
sort_3 = SortList(Keys=dist, ValuesA=disc.Points)  # -> Keys, ValuesA
item_3 = ListItem(List=sort_3.ValuesA, Index=0, Wrap=True)
scale = Scale(Geometry=rec, Center=item_3, Factor=Slider(3, range=0..10))  # -> Geometry, Transform
offset_9 = OffsetCurve(Curve=scale.Geometry, Distance=Slider(4, range=0..10), Corners=1)
flatten = FlattenTree(Tree=offset_9, Path="{0}")
rdiff = RegionDifference(CurvesA=offset_4, CurvesB=flatten)
explode_2 = Explode(Curve=rdiff, Recursive=True)  # -> Segments, Vertices
midpt = CurveMiddle(Curve=explode_2.Segments)
crv_cp_3 = CurveClosestPoint(Point=midpt, Curve=offset_4)  # -> Point, Parameter, Distance
smaller_2 = SmallerThan(FirstNumber=crv_cp_3.Distance, SecondNumber=Slider(0.01, range=0..0.01))  # -> SmallerThan, OrEqualTo
dispatch_2 = Dispatch(List=explode_2.Segments, DispatchPattern=smaller_2.SmallerThan)  # -> ListA, ListB
crv_13 = Curve(dispatch_2.ListA)
join_3 = JoinCurves(Curves=crv_13, Preserve=False)
crv_14 = Curve(join_3)
avr = Average(Input=flatten(item_3))
midpt_2 = CurveMiddle(Curve=crv_14)
ln = Line(StartPoint=midpt_2, EndPoint=avr)
与外围线连接的单一道路 = 与外围线连接的单一道路(T=ln, num=道路宽度, 外侧景观宽度=number_slider_3, 场地外围线=场地外围线_2, 外侧道路宽度=number_slider_2, 倒角半径=Slider(5, range=0..10))
crv_15 = Curve([<curve referenced from the Rhino model> x6])
pline = PolyLine(Vertices=ins_2, Closed=False)
Z_2 = UnitZ(Factor=1)
场地外围线_3 = Curve(crv_4)
crv_16 = Curve([<curve referenced from the Rhino model> x2])
crv_17 = Curve(<curve referenced from the Rhino model>)
crv_18 = Curve(crv_15)
crv_19 = Curve([pline, crv_17])
move_2 = Move(Geometry=crv_18, Motion=Z_2)  # -> Geometry, Transform
subtraction_2 = Subtraction(A=number_slider, B=1)
boundary_4 = BoundarySurfaces(Edges=move_2.Geometry)
extr_2 = Extrude(Base=boundary_4, Direction=expr("-2*x", Z_2))
场地周边种植 = 场地周边种植(
    随机程度=Slider(0.6, range=0..1),
    seed=Slider(3, range=0..10),
    C=场地外围线_3,
    D=number_slider_3,
    树木基础半径=Slider(2, range=0..10),
    疏密度_0_1=Slider(0.5, range=0..1))
道路生成 = 道路生成(
    外侧景观宽度=number_slider_3,
    外侧道路宽度=number_slider_2,
    crv=场地外围线_3,
    unit=Slider(1, range=0..1),
    轴线指定宽度=number_slider,
    指定轴线=crv_16,
    连接道路宽度=Slider(3, range=0..10),
    连接道路=crv_19,
    楼栋平面=crv_18)  # -> R, S, C
offset_10 = OffsetCurve(Curve=crv_16, Distance=expr("-x", subtraction_2), Corners=1)
offset_11 = OffsetCurve(Curve=crv_16, Distance=subtraction_2, Corners=1)
srf = Surface(道路生成.S)
trim_2 = TrimSolid(Shape=srf, Cutters=extr_2)
道路 = Surface(道路生成.R)
preview = CustomPreview(Geometry=道路, Material=ColourSwatch(SwatchColor=RGB(105, 105, 105)))
空地种植 = 空地种植(B=Slider(6.5, range=0..10), B_2=trim_2)
环绕种植 = 环绕种植(
    随机程度=Slider(0.2, range=0..1),
    seed=Slider(5, range=0..10),
    C=道路生成.C,
    树木基础半径=Slider(2, range=0..10),
    疏密度_0_1=Slider(0.4, range=0..1))
circlemesh = CSharpScript(Circle=[环绕种植, 场地周边种植, 空地种植], Num=Slider(8, range=0..10))  # -> A; inputs Num: Int32
# ---------- circlemesh: C# ----------
    //double[] tL = Circle.DivideByCount(Num, true);
    Point3d[] pL;
    int n;
    if(Num == 0)
      n = 6;
    else
      n = Num;
    NurbsCurve crv = Circle.ToNurbsCurve();
    crv.DivideByCount(n, true, out pL);

    Mesh mesh = new Rhino.Geometry.Mesh();
    mesh.Vertices.Add(Circle.Center);
    foreach(Point3d p in pL)
    {
      mesh.Vertices.Add(p);
    }
    for(int i = 1;i < pL.Length;i++)
    {
      mesh.Faces.AddFace(0, i, i + 1);
    }
    mesh.Faces.AddFace(0, pL.Length, 1);


    A = mesh;
# ---------- end circlemesh ----------
cluster = Cluster_2(seed=2, D=1)

# ==== cluster ScaleBox
num = ClusterInput()
R = ClusterInput()
num_2 = Number(num)
drec = DeconstuctRectangle(Rectangle=R)  # -> BasePlane, XInterval, YInterval
dedomain = DeconstructDomain(Domain=drec.XInterval)  # -> Start, End
dedomain_2 = DeconstructDomain(Domain=drec.YInterval)  # -> Start, End
subtraction = Subtraction(A=dedomain.Start, B=num_2)
addition = Addition(A=dedomain.End, B=num_2)
subtraction_2 = Subtraction(A=dedomain_2.Start, B=num_2)
addition_2 = Addition(A=dedomain_2.End, B=num_2)
dom = ConstructDomain(DomainStart=subtraction, DomainEnd=addition)
dom_2 = ConstructDomain(DomainStart=subtraction_2, DomainEnd=addition_2)
rectangle = Rectangle(Plane=drec.BasePlane, XSize=dom, YSize=dom_2, Radius=0)  # -> Rectangle, Length
R_2 = ClusterOutput(rectangle.Rectangle)

# ==== cluster 道路生成
unit = ClusterInput()
外侧道路宽度 = ClusterInput()
unit_2 = Number(unit)
combine = CombineData(Input0=外侧道路宽度, Input1=Slider(7, range=0..10))  # -> Result, Index
连接道路 = ClusterInput()
crv = ClusterInput()
外侧景观宽度 = ClusterInput()
multiplication = Multiplication(外围道路宽度=combine.Result, B=unit_2)
multiplication_2 = Multiplication(道路倒角半径=Slider(6, range=0..10), B=unit_2)
number_slider = Slider(0.4, range=0..1)
crv_2 = Curve(crv)
combine_2 = CombineData(Input0=外侧景观宽度, Input1=Slider(6, range=0..10))  # -> Result, Index
crv_3 = Curve(连接道路)
轴线指定宽度 = ClusterInput()
连接道路宽度 = ClusterInput()
指定轴线 = ClusterInput()
fillet = Fillet(Curve=crv_3, Radius=Slider(3, range=0..10))
crv_4 = Curve(fillet)
offset = OffsetCurve(Curve=crv_2, Distance=expr("-x", combine_2.Result), Corners=1)
offset_2 = OffsetCurve(Curve=offset, Distance=expr("-x", multiplication), Corners=1)
轴线分割 = 轴线分割(_0=轴线指定宽度, 连接道路宽度=连接道路宽度, 轴线控制比例=number_slider, E=offset_2, crv=指定轴线)
ext = ExtendCurve(Curve=fillet, Type=0, Start=Slider(0.5, range=0..1), End=Slider(0, range=0..100))
division = Division(A=连接道路宽度, B=2)
楼栋平面 = ClusterInput()
crv_5 = Curve(楼栋平面)

# ---- group: 在与楼栋平面相交处延长连接线，保证道路完整性
flatten = FlattenTree(Tree=crv_4, Path="{0}")
divide = DivideCurve(Curve=flatten, Count=Slider(1, range=0..1), Kinks=False)  # -> Points, Tangents, Parameters
graft = GraftTree(Tree=divide.Points, IncludeEmptyLists=True, IncludeNullItems=True)
crv_cp = CurveClosestPoint(Point=graft, Curve=crv_5)  # -> Point, Parameter, Distance
sort = SortList(Keys=crv_cp.Distance)  # -> Keys, ValuesA
item = ListItem(List=sort.Keys, Index=0, Wrap=True)
trim = TrimTree(Tree=item, Depth=1)
item_2 = ListItem(List=trim, Index=0, Wrap=True)
smaller = SmallerThan(FirstNumber=item_2, SecondNumber=Slider(0.1, range=0..0.1))  # -> SmallerThan, OrEqualTo
equals = Equality(FirstNumber=item_2, SecondNumber=0)  # -> Equality, Inequality
dispatch = Dispatch(List=flatten, DispatchPattern=flatten(smaller.SmallerThan))  # -> ListA, ListB
flip = FlipCurve(Curve=dispatch.ListB)  # -> Curve, Flag
entwine = Entwine(Branch00=dispatch.ListA, Branch01=flip.Curve, FlattenInputs=True)
flatten_2 = FlattenTree(Tree=entwine, Path="{0}")
ext_2 = ExtendCurve(Curve=flatten_2, Type=0, Start=Slider(5, range=0..10), End=Slider(0, range=0..100))

# ----
crv_6 = Curve(楼栋平面)
splitatcorners = SplitAtCorners(Poly=轴线分割, Angle=Slider(0.4, range=0..1))  # -> Corners, Parts
graft_2 = GraftTree(Tree=crv_6, IncludeEmptyLists=True, IncludeNullItems=True)
ccx = CurveCurve(CurveA=连接道路, CurveB=graft_2)  # -> Points, ParamsA, ParamsB
lng = ListLength(List=ccx.ParamsB)
pline = PolyLine(Vertices=splitatcorners.Corners, Closed=invert(False))
fillet_2 = Fillet(Curve=pline, Radius=multiplication_2)
fillet_3 = Fillet(Curve=offset_2, Radius=Slider(6, range=0..10))
轴线分割_2 = 轴线分割(连接道路=ext_2, _0=轴线指定宽度, 连接道路宽度=连接道路宽度, 轴线控制比例=number_slider, E=fillet_3, crv=指定轴线)

# ---- group: 楼栋平面修剪道路区域，并保证修剪后道路是闭合曲线
trim_2 = TrimWithRegions(Curve=轴线分割_2, Regions=crv_5)  # -> Inside, Outside
crv_7 = Curve(trim_2.Outside)
cls = Closed(Curve=crv_7)  # -> Closed, Periodic
dispatch_2 = Dispatch(List=crv_7, DispatchPattern=cls.Closed)  # -> ListA, ListB
end = EndPoints(Curve=dispatch_2.ListB)  # -> Start, End
ln = Line(StartPoint=end.Start, EndPoint=end.End)
merge = Merge(Data1=ln, Data2=dispatch_2.ListB)
join = JoinCurves(Curves=merge, Preserve=False)
merge_2 = Merge(Data1=simplify(join), Data2=simplify(dispatch_2.ListA))

# ---- group: 与楼栋交接处不倒角，其余地方正常倒角
crv_8 = Curve(reparameterize(merge_2))
disc = Discontinuity(Curve=crv_8, Level=1)  # -> Points, Parameters
flatten_3 = FlattenTree(Tree=disc.Points, Path="{0}")
crv_cp_2 = CurveClosestPoint(Point=graft(flatten_3), Curve=flatten(crv_5))  # -> Point, Parameter, Distance
sort_2 = SortList(Keys=crv_cp_2.Distance)  # -> Keys, ValuesA
item_3 = ListItem(List=sort_2.Keys, Index=0, Wrap=True)
smaller_2 = SmallerThan(FirstNumber=item_3, SecondNumber=Slider(0.1, range=0..0.1))  # -> SmallerThan, OrEqualTo
flatten_4 = FlattenTree(Tree=smaller_2.SmallerThan, Path="{0}")
unflatten = UnflattenTree(Tree=flatten_4, Guide=disc.Parameters)
dispatch_3 = Dispatch(List=disc.Parameters, DispatchPattern=unflatten)  # -> ListA, ListB
fillet_4 = Fillet(Curve=crv_8, Parameter=dispatch_3.ListB, Radius=Slider(3, range=0..10))  # -> Curve, Parameter
crv_9 = Curve(fillet_4.Curve)
multiplecrv_booleanintersection = CSharpScript(crv=crv_9)  # -> out, A; inputs crv: list of Curve
# ---------- multiplecrv_booleanintersection: C# ----------
    //Curve[] curves = new Curve[crv.Count];
    Curve finalCrv = crv[0];
    for(int i = 1;i < crv.Count;i++)
    {
      //curves[i] = crv[i];
      Curve[] curves = Curve.CreateBooleanIntersection(finalCrv, crv[i],0.001);
      if(curves.Length < 2)
      {
        finalCrv = curves[0];
      }
    }
    A = finalCrv;
# ---------- end multiplecrv_booleanintersection ----------
crv_10 = Curve(offset)
boundary = BoundarySurfaces(Edges=flatten([crv_10, multiplecrv_booleanintersection.A]))

# ----
equals_2 = Equality(FirstNumber=lng, SecondNumber=0)  # -> Equality, Inequality
dispatch_4 = Dispatch(List=graft_2, DispatchPattern=equals_2.Inequality)  # -> ListA, ListB
offset_3 = OffsetCurve(Curve=ext, Distance=expr("-x", division), Corners=1)
offset_4 = OffsetCurve(Curve=ext, Distance=division, Corners=1)
Z = UnitZ(Factor=1)
Z_2 = UnitZ(Factor=1)
boundary_2 = BoundarySurfaces(Edges=fillet_2)
flatten_5 = FlattenTree(Tree=dispatch_4.ListA, Path="{0}")
boundary_3 = BoundarySurfaces(Edges=flatten_5)
panel = Panel(merge_2)
multiplication_3 = Multiplication(A=Z_2, B=-2)
loft = Loft(
    Curves=[offset_4, offset_3],
    Options={Adjust=False, Closed=False, LoftEnds=0, LoftSimp=0, LoftType=0, Rebuild=10, Refit=0.01})
multiplication_4 = Multiplication(A=Z, B=-2)
entwine_2 = Entwine(Branch00=loft, Branch01=boundary_3, FlattenInputs=True)  # -> flatten(Result)
move = Move(Geometry=boundary_3, Motion=Z)  # -> Geometry, Transform
move_2 = Move(Geometry=entwine_2, Motion=Z)  # -> Geometry, Transform
extr = Extrude(Base=move.Geometry, Direction=multiplication_4)
extr_2 = Extrude(Base=move_2.Geometry, Direction=multiplication_4)
C = ClusterOutput(fillet_2)
boundary_4 = BoundarySurfaces(Edges=crv_2)
flatten_6 = FlattenTree(Tree=boundary_2, Path="{0}")
trim_3 = TrimSolid(Shape=flatten_6, Cutters=flatten(extr_2))
edges = BrepEdges(Brep=trim_3)  # -> Naked, Interior, NonManifold
join_2 = JoinCurves(Curves=edges.Naked, Preserve=False)
divlength = DivideLength(Curve=join_2, Length=Slider(1.8, range=0..10))  # -> Points, Tangents, Parameters
pline_2 = PolyLine(Vertices=divlength.Points, Closed=False)
splitatcorners_2 = SplitAtCorners(Poly=pline_2, Angle=Slider(0.09, range=0..1))  # -> Corners, Parts
panel_2 = Panel(trim_3)
pline_3 = PolyLine(Vertices=splitatcorners_2.Corners, Closed=invert(False))
fillet_5 = Fillet(Curve=pline_3, Radius=Slider(1, range=0..10))
boundary_5 = BoundarySurfaces(Edges=fillet_5)
move_3 = Move(Geometry=boundary_5, Motion=Z_2)  # -> Geometry, Transform
extr_3 = Extrude(Base=move_3.Geometry, Direction=multiplication_3)
S = ClusterOutput(boundary_5)
flatten_7 = FlattenTree(Tree=extr_3, Path="{0}")
trim_4 = TrimSolid(Shape=boundary_4, Cutters=flatten_7)  # disabled
boundary_6 = BoundarySurfaces(Edges=flatten([boundary_5, offset]))
trim_5 = TrimSolid(Shape=boundary_6, Cutters=extr)
R = ClusterOutput(trim_5)

# ==== cluster 场地周边种植
疏密度_0_1 = ClusterInput()
树木基础半径 = ClusterInput()
C = ClusterInput()
D = ClusterInput()
combine = CombineData(Input0=疏密度_0_1, Input1=Slider(0, range=0..1))  # -> Result, Index
combine_2 = CombineData(Input0=树木基础半径, Input1=Slider(2, range=0..10))  # -> Result, Index
number_slider = Slider(0.2, range=0..1)
offset = OffsetCurve(Curve=C, Distance=expr("-x/2", D), Corners=0)
随机程度 = ClusterInput()
seed = ClusterInput()
multiplication = Multiplication(A=combine_2.Result, B=2)
addition = Addition(A=combine.Result, B=1)
combine_3 = CombineData(Input0=随机程度, Input1=number_slider)  # -> Result, Index
combine_4 = CombineData(Input0=随机程度, Input1=number_slider)  # -> Result, Index
multiplication_2 = Multiplication(A=multiplication, B=addition)
subtraction = Subtraction(A=1, B=combine_4.Result)
addition_2 = Addition(A=combine_3.Result, B=1)
divlength = DivideLength(Curve=offset, Length=multiplication_2)  # -> Points, Tangents, Parameters
expression = Expression(x=combine_2.Result, y=subtraction, Expression="x*y")
expression_2 = Expression(x=combine_2.Result, y=addition_2, Expression="x*y")
expression_3 = Expression(x=D, Expression="x/2*1.5")
lng = ListLength(List=divlength.Points)
dom = ConstructDomain(DomainStart=expression, DomainEnd=expression_2)
c_script = CSharpScript(x=随机程度)  # -> A; inputs x: Double
# ---------- c_script: C# ----------
    A = (x == null || x == 0);
# ---------- end c_script ----------
random = Random(Range=dom, Number=lng, Seed=seed)
filter = StreamFilter(Gate=c_script, Stream0=random, Stream1=combine_2.Result)
c_script_2 = CSharpScript(x=filter, y=expression_3)  # -> out, A; inputs x: Double, y: Double
# ---------- c_script_2: C# ----------
    if(x >= y)
      A = y;
    else
      A = x;
# ---------- end c_script_2 ----------
cir = Circle(Plane=divlength.Points, Radius=c_script_2.A)
outputtrees = ClusterOutput(cir)

# ==== cluster Cluster_2
树木基础半径 = ClusterInput()
C = ClusterInput()
D = ClusterInput()
combine = CombineData(Input0=树木基础半径, Input1=Slider(2, range=0..10))  # -> Result, Index
number_slider = Slider(0.2, range=0..1)
offset = OffsetCurve(Curve=C, Distance=expr("-x/2", D), Corners=0)
随机程度 = ClusterInput()
seed = ClusterInput()
multiplication = Multiplication(A=combine.Result, B=2)
divlength = DivideLength(Curve=offset, Length=multiplication)  # -> Points, Tangents, Parameters
combine_2 = CombineData(Input0=随机程度, Input1=number_slider)  # -> Result, Index
combine_3 = CombineData(Input0=随机程度, Input1=number_slider)  # -> Result, Index
subtraction = Subtraction(A=1, B=combine_3.Result)
addition = Addition(A=combine_2.Result, B=1)
expression = Expression(x=combine.Result, y=subtraction, Expression="x*y")
expression_2 = Expression(x=combine.Result, y=addition, Expression="x*y")
expression_3 = Expression(x=D, Expression="x/2*1.5")
lng = ListLength(List=divlength.Points)
dom = ConstructDomain(DomainStart=expression, DomainEnd=expression_2)
c_script = CSharpScript(x=随机程度)  # -> A; inputs x: Double; same code as c_script
random = Random(Range=dom, Number=lng, Seed=seed)
filter = StreamFilter(Gate=c_script, Stream0=random, Stream1=combine.Result)
c_script_2 = CSharpScript(x=filter, y=expression_3)  # -> out, A; inputs x: Double, y: Double; same code as c_script_2
cir = Circle(Plane=divlength.Points, Radius=c_script_2.A)
outputtrees = ClusterOutput(cir)

# ==== cluster 环绕种植
树木基础半径 = ClusterInput()
疏密度_0_1 = ClusterInput()
combine = CombineData(Input0=树木基础半径, Input1=Slider(2, range=0..10))  # -> Result, Index
combine_2 = CombineData(Input0=疏密度_0_1, Input1=Slider(0, range=0..1))  # -> Result, Index
multiplication = Multiplication(A=combine.Result, B=2)
number_slider = Slider(0.2, range=0..1)
addition = Addition(A=combine_2.Result, B=1)
随机程度 = ClusterInput()
seed = ClusterInput()
C = ClusterInput()
multiplication_2 = Multiplication(A=multiplication, B=addition)
divlength = DivideLength(Curve=C, Length=multiplication_2)  # -> Points, Tangents, Parameters
combine_3 = CombineData(Input0=随机程度, Input1=number_slider)  # -> Result, Index
combine_4 = CombineData(Input0=随机程度, Input1=number_slider)  # -> Result, Index
subtraction = Subtraction(A=1, B=combine_4.Result)
addition_2 = Addition(A=combine_3.Result, B=1)
expression = Expression(x=combine.Result, y=subtraction, Expression="x*y")
expression_2 = Expression(x=combine.Result, y=addition_2, Expression="x*y")
lng = ListLength(List=divlength.Points)
expression_3 = Expression(x=combine.Result, Expression="x*1.5")
dom = ConstructDomain(DomainStart=expression, DomainEnd=expression_2)
c_script = CSharpScript(x=随机程度)  # -> A; inputs x: Double; same code as c_script
random = Random(Range=dom, Number=lng, Seed=seed)
filter = StreamFilter(Gate=c_script, Stream0=random, Stream1=combine.Result)
c_script_2 = CSharpScript(x=filter, y=expression_3)  # -> out, A; inputs x: Double, y: Double; same code as c_script_2
cir = Circle(Plane=divlength.Points, Radius=c_script_2.A)
outputtrees = ClusterOutput(cir)

# ==== cluster 空地种植
B = ClusterInput()
B_2 = ClusterInput()
custom_mesh_settings = SettingsCustom(
    StitchSeams=True,
    SimplePlanes=False,
    Refine=True,
    MinCount=16,
    MaxCount=400,
    AspectRatio=20,
    MaxDistance=0,
    MaxAngle=20,
    MinEdge=0,
    MaxEdge=0)
mesh = MeshBrep(Brep=B_2, Settings=custom_mesh_settings)
mesh_2 = Mesh(mesh)
tri = Triangulate(Mesh=mesh_2)  # -> Mesh, Count
faceb = FaceBoundaries(Mesh=tri.Mesh)
explode = Explode(Curve=faceb, Recursive=True)  # -> Segments, Vertices
len = Length(Curve=explode.Segments)
sort = SortList(Keys=len, ValuesA=explode.Segments)  # -> Keys, ValuesA
item = ListItem(List=sort.ValuesA, Index=0, Wrap=True)
larger = LargerThan(FirstNumber=item, SecondNumber=B)  # -> LargerThan, OrEqualTo
flatten = FlattenTree(Tree=faceb, Path="{0}")
flatten_2 = FlattenTree(Tree=larger.LargerThan, Path="{0}")
dispatch = Dispatch(List=flatten, DispatchPattern=flatten_2)  # -> ListA, ListB
crv = Curve(dispatch.ListA)
disc = Discontinuity(Curve=crv, Level=1)  # -> Points, Parameters
item_2 = ListItem(List=disc.Points, Index=0, Wrap=True)  # -> Item, Item1, Item2
incircle = InCircle(CornerA=item_2.Item, CornerB=item_2.Item1, CornerC=item_2.Item2)  # -> Circle, Plane, Radius
clean = CleanTree(RemoveNulls=True, RemoveInvalid=True, RemoveEmpty=False, Tree=flatten(incircle.Circle))
circle = Circle(clean)
circle_2 = ClusterOutput(circle)

# ==== cluster 与外围线连接的单一道路
T = ClusterInput()
外侧景观宽度 = ClusterInput()
flatten = FlattenTree(Tree=T, Path="{0}")
场地外围线 = ClusterInput()
外侧景观宽度_2 = Number(外侧景观宽度)
divide = DivideCurve(Curve=flatten, Count=1, Kinks=False)  # -> Points, Tangents, Parameters
场地外围线_2 = Curve(场地外围线)
num = ClusterInput()
外侧道路宽度 = ClusterInput()
area = Area(Geometry=场地外围线_2)  # -> Area, Centroid
num_2 = Number(num)
offset = OffsetCurve(Curve=场地外围线_2, Distance=expr("-x", 外侧景观宽度_2), Corners=1)
dist = Distance(PointA=divide.Points, PointB=area.Centroid)
sort = SortList(Keys=dist, ValuesA=divide.Points)  # -> Keys, ValuesA
division = Division(A=num_2, B=2)
addition = Addition(外侧景观宽度=外侧景观宽度_2, 外侧道路宽度=外侧道路宽度)
item = ListItem(List=sort.ValuesA, Index=0, Wrap=True)  # -> Item, Item1
ln = Line(StartPoint=item.Item1, EndPoint=item.Item)
offset_2 = OffsetCurve(Curve=场地外围线_2, Distance=expr("-x", addition), Corners=1)
flatten_2 = FlattenTree(Tree=ln, Path="{0}")
ext = ExtendCurve(Curve=flatten_2, Type=0, Start=Slider(10, range=0..10), End=0)
offset_3 = OffsetCurve(Curve=ext, Distance=expr("-x", division), Corners=1)
offset_4 = OffsetCurve(Curve=ext, Distance=division, Corners=1)
merge = Merge(Data1=offset_4, Data2=offset_3)
loft = Loft(Curves=merge, Options={Adjust=False, Closed=False, LoftEnds=0, LoftSimp=0, LoftType=0, Rebuild=10, Refit=0.01})
倒角半径 = ClusterInput()
rdiff = RegionDifference(CurvesA=offset_2, CurvesB=flatten(loft))
倒角半径_2 = Number(倒角半径)
fillet = Fillet(Curve=rdiff, Radius=倒角半径_2)
fillet_2 = Fillet(Curve=offset, Radius=倒角半径_2)
boundary = BoundarySurfaces(Edges=flatten([fillet, fillet_2]))
outputpath = ClusterOutput(boundary)

# ==== cluster 轴线分割: 沿轴线将场地进行初步分割; 可以分别调整y轴正负方向的偏移量
crv = ClusterInput()
E = ClusterInput()
crv_2 = Curve(crv)
graft = GraftTree(Tree=crv_2, IncludeEmptyLists=True, IncludeNullItems=True)
item = ListItem(List=graft, Index=0, Wrap=True)

# ---- group: 判定是否更趋向于x轴
end = EndPoints(Curve=graft)  # -> Start, End
vec2pt = Vector2Pt(PointA=end.Start, PointB=end.End, Unitize=False)  # -> Vector, Length
X = UnitX(Factor=1)
rev = Reverse(Vector=X)
angle = Angle(VectorA=vec2pt.Vector, VectorB=rev)  # -> Angle, Reflex
angle_2 = Angle(VectorA=vec2pt.Vector, VectorB=X)  # -> Angle, Reflex
pi = Pi(Factor=Slider(0.25, range=0..1))
smaller = SmallerThan(FirstNumber=angle_2.Angle, SecondNumber=pi)  # -> SmallerThan, OrEqualTo
smaller_2 = SmallerThan(FirstNumber=angle.Angle, SecondNumber=pi)  # -> SmallerThan, OrEqualTo
or = GateOr(A=smaller.SmallerThan, B=smaller_2.SmallerThan)

# ---- group: 确定x，y轴的避让距离
bbox = BoundingBox(Content=E, Plane=PlaneXY(0, 0, 0))  # -> Box, Box_2
底面边界 = 底面边界(B=bbox.Box, G=0)
cluster = Cluster(C=底面边界, axis="x")
cluster_2 = Cluster(C=底面边界, axis="y")
number_slider = Slider(5, range=0..10)
division = Division(A=cluster, B=number_slider)
division_2 = Division(A=cluster_2, B=number_slider)
X_2 = UnitX(Factor=1)
Y = UnitY(Factor=1)
contour = Contour(Shape=E, Point=Point(0, 0, 0), Direction=X_2, Distance=division)
contour_2 = Contour(Shape=E, Point=Point(0, 0, 0), Direction=Y, Distance=division_2)
len = Length(Curve=contour)  # -> flatten(Length)
len_2 = Length(Curve=contour_2)  # -> flatten(Length)
number_slider_2 = Slider(15, range=0..100)
avr = Average(Input=len)
avr_2 = Average(Input=len_2)
division_3 = Division(A=avr, B=number_slider_2)
division_4 = Division(A=avr_2, B=number_slider_2)

# ----
dispatch = Dispatch(List=graft, DispatchPattern=or)  # -> ListA, ListB
boundary = BoundarySurfaces(Edges=E)
轴线控制比例 = ClusterInput()  # 用于控制道路与实际排布地块，最高为1，用于道路时适当降低
y轴方向避让距离 = Number(division_3)
x轴方向避让距离 = Number(division_4)
_0 = ClusterInput()
multiplication = Multiplication(A=轴线控制比例, B=x轴方向避让距离)
multiplication_2 = Multiplication(A=轴线控制比例, B=y轴方向避让距离)
combine = CombineData(Input0=_0, Input1=multiplication_2)  # -> Result, Index
combine_2 = CombineData(Input0=_0, Input1=multiplication)  # -> Result, Index
num = Number(combine_2.Result)
num_2 = Number(combine.Result)

# ---- group: 判断线段偏移正负方向，y轴负方向会偏移更多
midpt = CurveMiddle(Curve=dispatch.ListA)
crv_cp = CurveClosestPoint(Point=midpt, Curve=dispatch.ListA)  # -> Point, Parameter, Distance
hframe = HorizontalFrame(Curve=dispatch.ListA, Parameter=crv_cp.Parameter)
deplane = DeconstructPlane(Plane=hframe)  # -> Origin, XAxis, YAxis, ZAxis
c_script = CSharpScript(Vec=deplane.YAxis)  # -> yPositive, yNegative; inputs Vec: Vector3d
# ---------- c_script: C# ----------
    Vector3d yVec = new Vector3d(0, 1, 0);
    if(Vec * yVec > 0)
    {
      yPositive = Vec;
      yNegative = -Vec;
    }
    if(Vec * yVec < 0)
    {
      yPositive = -Vec;
      yNegative = Vec;
    }
# ---------- end c_script ----------
pl = ConstructPlane(Origin=deplane.Origin, XAxis=deplane.XAxis, YAxis=c_script.yNegative)
pl_2 = ConstructPlane(Origin=deplane.Origin, XAxis=deplane.XAxis, YAxis=c_script.yPositive)
multiplication_3 = Multiplication(A=Slider(1, range=0..10), B=num_2)
offset = OffsetCurve(Curve=dispatch.ListA, Distance=num_2, Plane=pl, Corners=1)
offset_2 = OffsetCurve(Curve=dispatch.ListA, Distance=multiplication_3, Plane=pl_2, Corners=1)

# ----
offset_3 = OffsetCurve(Curve=dispatch.ListB, Distance=expr("-x", num), Corners=1)
offset_4 = OffsetCurve(Curve=dispatch.ListB, Distance=num, Corners=1)
simplify = SimplifyTree(Tree=offset, Front=False)
simplify_2 = SimplifyTree(Tree=offset_2, Front=False)
连接道路宽度 = ClusterInput()
simplify_3 = SimplifyTree(Tree=offset_4, Front=False)
simplify_4 = SimplifyTree(Tree=offset_3, Front=False)
连接道路 = ClusterInput()
division_5 = Division(A=连接道路宽度, B=2)
merge = Merge(Data1=simplify_3, Data2=simplify_4, Data3=simplify, Data4=simplify_2)
combine_3 = CombineData(Input0=division_5, Input1=Slider(1.5, range=0..10))  # -> Result, Index
clean = CleanTree(RemoveNulls=True, RemoveInvalid=True, RemoveEmpty=False, Tree=merge)
offset_5 = OffsetCurve(Curve=连接道路, Distance=expr("-x", combine_3.Result), Corners=1)
offset_6 = OffsetCurve(Curve=连接道路, Distance=combine_3.Result, Corners=1)
Z = UnitZ(Factor=1)
loft = Loft(Curves=clean, Options={Adjust=False, Closed=False, LoftEnds=0, LoftSimp=0, LoftType=0, Rebuild=10, Refit=0.01})
merge_2 = Merge(Data1=offset_6, Data2=offset_5)
panel = Panel(clean)
multiplication_4 = Multiplication(A=Z, B="-2")
loft_2 = Loft(Curves=merge_2, Options={Adjust=False, Closed=False, LoftEnds=0, LoftSimp=0, LoftType=0, Rebuild=10, Refit=0.01})
entwine = Entwine(Branch00=loft_2, Branch01=loft, FlattenInputs=True)
move = Move(Geometry=entwine, Motion=Z)  # -> Geometry, Transform
extr = Extrude(Base=move.Geometry, Direction=multiplication_4)
flatten = FlattenTree(Tree=extr, Path="{0}")
clean_2 = CleanTree(RemoveNulls=True, RemoveInvalid=True, RemoveEmpty=False, Tree=flatten)
trim = TrimSolid(Shape=boundary, Cutters=clean_2)
edges = BrepEdges(Brep=trim)  # -> Naked, Interior, NonManifold
join = JoinCurves(Curves=edges.Naked, Preserve=False)
simplify_5 = SimplifyTree(Tree=join, Front=False)
T = ClusterOutput(simplify_5)

# ==== cluster Cluster: 指定轴线方向矩形长度
C = ClusterInput()
axis = ClusterInput()
explode = Explode(Curve=C, Recursive=True)  # -> Segments, Vertices
c_script = CSharpScript(axis=axis)  # -> A; inputs axis: String
# ---------- c_script: C# ----------
    if(axis == "x" || axis == "X") A = 0;
    if(axis == "y" || axis == "Y") A = 1;
    if(axis == "z" || axis == "Z") A = 2;
# ---------- end c_script ----------
midpt = CurveMiddle(Curve=explode.Segments)
pdecon = Deconstruct(Point=midpt)  # -> XComponent, YComponent, ZComponent
filter = StreamFilter(Gate=c_script, Stream0=pdecon.XComponent, Stream1=pdecon.YComponent, Stream2=pdecon.ZComponent)
item = ListItem(List=filter, Index=0, Wrap=True)  # -> Item, Item1, Item2, Item3
subtraction = Subtraction(A=item.Item, B=item.Item2)
subtraction_2 = Subtraction(A=item.Item1, B=item.Item3)
abs = Absolute(Value=subtraction)
abs_2 = Absolute(Value=subtraction_2)
c_script_2 = CSharpScript(x=abs, y=abs_2)  # -> A; inputs x: Double, y: Double
# ---------- c_script_2: C# ----------
    if(x > y) A = x;
    else A = y;
# ---------- end c_script_2 ----------
length = ClusterOutput(c_script_2)

# ==== cluster 底面边界: 获取物体上下面边界曲线Polyline； G为0时取底面边界； G为1时取顶面边界；
B = ClusterInput()
debrep = DeconstructBrep(Brep=B)  # -> Faces, Edges, Vertices
pcen = PolygonCenter(Polyline=debrep.Faces)  # -> CenterV, CenterE, CenterA
pdecon = Deconstruct(Point=pcen.CenterV)  # -> XComponent, YComponent, ZComponent
sort = SortList(Keys=pdecon.ZComponent, ValuesA=debrep.Faces)  # -> Keys, ValuesA
item = ListItem(List=reverse(sort.ValuesA), Index=0, Wrap=True)
item_2 = ListItem(List=sort.ValuesA, Index=0, Wrap=True)
G = ClusterInput()
filter = StreamFilter(Gate=G, Stream0=item_2, Stream1=item)
edges = BrepEdges(Brep=filter)  # -> Naked, Interior, NonManifold
join = JoinCurves(Curves=edges.Naked, Preserve=False)
trim = TrimTree(Tree=join, Depth=Slider(3, range=0..10))
T = ClusterOutput(trim)
